# Grasshopper definition Display_Preview.ghx (Grasshopper 1.0.7)

# ---- group: Create Material
# Display Preview
transparency = Slider(0.5, range=0..1)
shine = Slider(1, range=0..100)
# GH#: A C# dictionary of Grasshopper3D components.
# 
# This file contains a category of Grasshopper components, and a mirroring C#/RhinoCommon implementation.
# 
# This is an educational project initiated by students/faculty of GSD-6338: Introduction to Computational Design, at the Harvard Graduate School of Design.
# 
# More information: {{project link}}
swatch = ColourSwatch(SwatchColor=RGB(93, 255, 255))
swatch_2 = ColourSwatch(SwatchColor=RGB(255, 255, 255))
swatch_3 = ColourSwatch(SwatchColor=RGB(114, 89, 255))
material = CreateMaterial(Diffuse=swatch, Specular=swatch_2, Emission=swatch_3, Transparency=transparency, Shine=shine)
gh_material = CSharpScript(Kd=swatch, Ks=swatch_2, Ke=swatch_3, T=transparency, S=shine)  # -> out, M; inputs Kd: Color, Ks: Color, Ke: Color, T: Double, S: Int32
# ---------- gh_material: C# ----------
    // Component written by @thekaushikls

    // This component helps create a custom Display Material from
    // DiffuseColor(Kd), SpecularColor(Ks), EmissionColor(Ke),
    // Transparency(T) and Shine(S).

    Rhino.Display.DisplayMaterial newMaterial = new Rhino.Display.DisplayMaterial(Kd, T);
    newMaterial.Specular = Ks;
    newMaterial.Emission = Ke;
    newMaterial.Shine = S;

    // Rhino material needs to be converted to GH_Material to use inside GH.
    // Grasshopper.Kernel.Types.GH_Material
    GH_Material newGHMaterial = new GH_Material(newMaterial);

    // Output
    M = newGHMaterial;
# ---------- end gh_material ----------
samplegeometry = Geometry(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)
panel = Panel(material)
panel_2 = Panel(gh_material.M)
samplegeometry_2 = Geometry(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)
preview = CustomPreview(Geometry=samplegeometry, Material=material)
preview_2 = CustomPreview(Geometry=samplegeometry_2, Material=gh_material.M)

# ---- group: Custom Preview
transparency_2 = Slider(0.6, range=0..1)
shine_2 = Slider(1, range=0..100)
samplegeometry_3 = Geometry(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)
samplegeometry_4 = Geometry(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)
material_2 = CreateMaterial(
    Diffuse=ColourSwatch(SwatchColor=RGB(0, 0, 96)),
    Specular=ColourSwatch(SwatchColor=RGB(255, 0, 31)),
    Emission=ColourSwatch(SwatchColor=RGB(255, 29, 74)),
    Transparency=transparency_2,
    Shine=shine_2)
preview_3 = CustomPreview(Geometry=samplegeometry_3, Material=material_2)
gh_preview = CSharpScript(G=samplegeometry_4, M=material_2)  # -> out; inputs G: GeometryBase
# ---------- gh_preview: C# ----------
    // Component by @thekaushikls

    this.Component.AddRuntimeMessage(
      GH_RuntimeMessageLevel.Warning,
      "Need to implement for Points, Lines, Curves, etc.");

    // This component draws input Geometry using input Material.

    // Storing inputs in global scope. Now we can access
    // these from outside the RunScript method.
    inputGeometry = G;
    // Cast System.Object to DisplayMaterial.
    inputMaterial = (Rhino.Display.DisplayMaterial) M;

    wireframeColor = System.Drawing.Color.FromArgb(100, inputMaterial.Diffuse.R, inputMaterial.Diffuse.G, inputMaterial.Diffuse.B);
# ---------- gh_preview: C# additional code ----------
  // Storing these in global variables.
  private GeometryBase inputGeometry;
  private System.Drawing.Color wireframeColor;
  private Rhino.Display.DisplayMaterial inputMaterial;

  //Return a BoundingBox that contains all the geometry you are about to draw.
  public override BoundingBox ClippingBox
  {
    get
    {
      // This check makes sure the script does not break when no input is connected.
      if (this.inputGeometry != null)
        return this.inputGeometry.GetBoundingBox(false);
      else
        return BoundingBox.Unset;
    }
  }

  //Draw all meshes in this method.
  public override void DrawViewportMeshes(IGH_PreviewArgs args)
  {

    // Draw only when input is connected.
    if (this.inputGeometry != null)
    {
      // If set to true, the drawn geometry hides / masks geometry behind it.
      args.Display.EnableDepthWriting(false);

      args.Display.DrawBrepShaded((Brep) this.inputGeometry, this.inputMaterial);
      args.Display.DrawBrepWires((Brep) this.inputGeometry, this.wireframeColor, -1);
    }
  }
  //Draw all wires and points in this method.
  public override void DrawViewportWires(IGH_PreviewArgs args)
  {
    // Exactly same as Shaded
    this.DrawViewportMeshes(args);
  }
# ---------- end gh_preview ----------
panel_3 = Panel(gh_preview)
